# Grasshopper definition boxes.gh (Grasshopper 0.9.76)
# plug-ins: Biomorpher

number_slider = Slider(5.21130331, range=0..10)
number_slider_2 = Slider(6.06264816, range=0..10)
number_slider_3 = Slider(7.09461571, range=0..10)
number_slider_4 = Slider(2.05947253, range=0..10)
number_slider_5 = Slider(6.15718348, range=0..10)
number_slider_6 = Slider(8.08556907, range=0..10)
number_slider_7 = Slider(4.90342473, range=0..10)
number_slider_8 = Slider(9.98205881, range=0..10)
number_slider_9 = Slider(1.12848556, range=0..10)
number_slider_10 = Slider(3.53727688, range=0..10)
number_slider_11 = Slider(4.17602794, range=0..10)
number_slider_12 = Slider(4.76194057, range=0..10)
number_slider_13 = Slider(1.3672805, range=0..10)
number_slider_14 = Slider(6.47190709, range=0..10)
number_slider_15 = Slider(2.46561509, range=0..10)
number_slider_16 = Slider(1.57731234, range=0..10)
number_slider_17 = Slider(3.72109878, range=0..10)
number_slider_18 = Slider(8.07755717, range=0..10)
dom = ConstructDomain(DomainStart=number_slider, DomainEnd=number_slider_2)
dom_2 = ConstructDomain(DomainStart=number_slider_3, DomainEnd=number_slider_4)
dom_3 = ConstructDomain(DomainStart=number_slider_5, DomainEnd=number_slider_6)
dom_4 = ConstructDomain(DomainStart=number_slider_7, DomainEnd=number_slider_8)
dom_5 = ConstructDomain(DomainStart=number_slider_12, DomainEnd=number_slider_9)
dom_6 = ConstructDomain(DomainStart=number_slider_13, DomainEnd=number_slider_10)
dom_7 = ConstructDomain(DomainStart=number_slider_11, DomainEnd=number_slider_14)
dom_8 = ConstructDomain(DomainStart=number_slider_15, DomainEnd=number_slider_16)
dom_9 = ConstructDomain(DomainStart=number_slider_17, DomainEnd=number_slider_18)
dom_10 = ConstructDomain(DomainStart=Slider(3, range=0..10), DomainEnd=Slider(7, range=0..10))
box = DomainBox(Base=PlaneXY(0, 0, 0), X=dom_10, Y=dom_10, Z=dom_10)
box_2 = DomainBox(Base=PlaneXY(0, 0, 0), X=dom, Y=dom_2, Z=dom_3)
box_3 = DomainBox(Base=PlaneXY(0, 0, 0), X=dom_4, Y=dom_5, Z=dom_6)
box_4 = DomainBox(Base=PlaneXY(0, 0, 0), X=dom_7, Y=dom_8, Z=dom_9)
sdiff = SolidDifference(BrepsA=box, BrepsB=[box_2, box_4, box_3])
mesh = Mesh(sdiff)
biomorpher = Biomorpher(
    Genome=[number_slider_18, number_slider_17, number_slider_16, number_slider_15, number_slider_14, number_slider_11, number_slider_6, number_slider_5, number_slider_4, number_slider_3, number_slider_2, number_slider, number_slider_7, number_slider_8, number_slider_12, number_slider_9, number_slider_13, number_slider_10],
    Geometry=mesh)
