# Grasshopper definition mobius.gh (Grasshopper 0.9.76)
# plug-ins: Biomorpher, MeshEdit Components, LunchBox, Weaverbird

number_slider = Slider(4, range=0..5)
number_slider_2 = Slider(3, range=2..10)
number_slider_3 = Slider(90, range=29..100)
mobius = MobiusSurface(
    UDivisions=100,
    VDivisions=100,
    RParameter=4,
    TParameter=number_slider,
    Scale=5,
    Domain1=Domain(-3.141592654, 3.141592654),
    Domain2=Domain(-1, 1))
hex = HexagonCells(Surface=mobius, UDivisions=number_slider_3, VDivisions=number_slider_2, TParameter=0.25)  # -> HexagonCells, Centers
wbframe = WeaverbirdsPictureFrame(MeshPolylines=hex.HexagonCells, Distance=5, InsetType=0)
wbthicken = WeaverbirdsMeshThicken(MeshCurves=wbframe, Distance=Slider(2.9, range=0..10), OffsetType=0)
demesh = DeconstructMesh(Mesh=wbthicken)  # -> Vertices, Faces, Colours, Normals
area = MeshArea(Mesh=wbthicken)  # -> Area, Centroid
mcol = MeshColours(
    Mesh=wbthicken,
    Colours=[RGB(127, 255, 0), RGB(0, 100, 0), RGB(34, 139, 34), RGB(124, 252, 0), RGB(154, 205, 50), RGB(173, 255, 47), RGB(50, 205, 50), RGB(152, 251, 152)])
lng = ListLength(List=demesh.Vertices)
num = Number(lng)
biomorpher = Biomorpher(Genotype=[number_slider_3, number_slider_2, number_slider], Geometry=mcol, Performance=[num, area.Area])
list_item = ListItem(List=biomorpher, Index=0, Wrap=True)  # -> Item, Item1, Item2
construct_point = ConstructPoint(XCoordinate=list_item.Item, YCoordinate=list_item.Item1, ZCoordinate=list_item.Item2)

# ---- group: Cluster no.
cluster = Slider(0, range=0..12)

# ----
shift_paths = ShiftPaths(Data=construct_point, Offset=-1)
panel = Panel(biomorpher)
tree_branch = TreeBranch(Tree=shift_paths, Path=cluster, MaintainPaths=True)
tstat = TreeStatistics(Tree=shift_paths)  # -> Paths, Length, Count
range = Range(Domain=Domain(0, 1), Steps=expr("X-1", tstat.Count))
gradient = Gradient(
    LowerLimit=0,
    UpperLimit=1,
    Parameter=range,
    stops=[0: RGB(243, 57, 0), 0.1: RGB(236, 27, 60), 0.2: RGB(210, 0, 118), 0.3: RGB(103, 0, 120), 0.4: RGB(39, 72, 161), 0.5: RGB(1, 192, 229), 0.6: RGB(18, 178, 90), 0.7: RGB(79, 186, 8), 0.8: RGB(220, 237, 32), 0.9: RGB(247, 159, 20), 1: RGB(243, 57, 0)])
col = Colour(graft(gradient))
dots = DotDisplay(Point=shift_paths, Colour=col, Size=Slider(0.02, range=0..0.1))
