# Grasshopper definition BooleanBoxes.gh (Grasshopper 1.0.7)
# plug-ins: MeshEdit Components, Biomorpher

genes = GenePool(
    Decimals=2,
    Maximum=10,
    Minimum=0,
    Value=[3.700306869, 1.704799472, 1.545812165, 8.957148147, 4.728665451, 6.498228754, 2.649370457, 3.470941289, 9.405870361, 1.913185971])
genes_2 = GenePool(
    Decimals=2,
    Maximum=10,
    Minimum=0,
    Value=[0.4941628453, 4.068423785, 2.488126668, 4.29240281, 9.746708343, 3.038230713, 2.994793116, 3.760116244, 0.7555748483, 1.198598751])
genes_3 = GenePool(
    Decimals=2,
    Maximum=10,
    Minimum=0,
    Value=[8.439605557, 2.474833836, 9.344657632, 2.660695332, 0.9434310744, 5.40152452, 5.759554962, 9.110140524, 4.673773882, 8.321316768])
genes_4 = GenePool(
    Decimals=2,
    Maximum=10,
    Minimum=0,
    Value=[6.701410013, 9.449394739, 9.267411664, 1.505935682, 6.004597668, 4.747663989, 1.919335869, 6.281085159, 6.03561077, 2.216090207])
genes_5 = GenePool(
    Decimals=2,
    Maximum=10,
    Minimum=0,
    Value=[7.597391512, 2.555241585, 6.994750017, 0.1066823727, 0.1662008267, 3.742258562, 8.310629868, 3.011989319, 0.6606585947, 2.617343329])
genes_6 = GenePool(
    Decimals=2,
    Maximum=10,
    Minimum=0,
    Value=[4.210943066, 3.290180756, 9.87154986, 7.183285886, 2.949474169, 1.225473033, 2.35014184, 8.875116833, 1.579765083, 9.31714093])
dom = ConstructDomain(DomainStart=genes, DomainEnd=genes_2)
dom_2 = ConstructDomain(DomainStart=genes_3, DomainEnd=genes_4)
dom_3 = ConstructDomain(DomainStart=genes_5, DomainEnd=genes_6)
box = DomainBox(Base=PlaneXY(0, 0, 0), X=dom, Y=dom_2, Z=dom_3)
bbox = BoundingBox(Content=box, Plane=PlaneXY(0, 0, 0), UnionBox=True)  # -> Box, Box_2
volume = Volume(Geometry=bbox.Box)  # -> Volume, Centroid
scale = Scale(Geometry=bbox.Box, Center=volume.Centroid, Factor="0.9")  # -> Geometry, Transform
number_slider = Slider(16, range=0..254)
number_slider_2 = Slider(213, range=0..254)
number_slider_3 = Slider(35, range=0..254)
sdiff = SolidDifference(BrepsA=scale.Geometry, BrepsB=box)
rgb = ColourRGB(Alpha=255, Red=number_slider, Green=number_slider_2, Blue=number_slider_3)
mesh = MeshBrep(
    Brep=sdiff,
    Settings={GridMaxCount=0, GridMinCount=16, JaggedSeams=False, MaxEdgeLength=0, MinEdgeLength=0.0001, MinTolerance=0, Refine=True, RefineAngle=0, RelativeTolerance=0.65, SimplePlanes=True, Tolerance=0})
mjoin = MeshJoin(Meshes=mesh)
mcol = MeshColours(Mesh=mjoin, Colours=rgb)
# Analyse volume
volume_2 = MeshVolume(Mesh=mcol)  # -> Volume, Centroid
biomorpher = Biomorpher(
    Genome=[genes, genes_2, genes_3, genes_4, genes_5, genes_6, number_slider, number_slider_2, number_slider_3],
    Meshes=mcol,
    Perform=volume_2.Volume)
